# Grasshopper definition 20200501 Test 1.gh (Grasshopper 1.0.7)
# plug-ins: Pufferfish, Tree8, Sunflower

# ---- group: Reset Shape Grammar
button = Button()

# ---- group: Design options
list = ValueList({"Option 0": 0, "Option 1": 1, "Option 2": 2, "Option 3": 3, "Option 4": 4}, selected="Option 4")

# ---- group: True for running the environmental analysis
run = BooleanToggle(True)

# ---- group: Shape grammar design (using SortalGI) / Rule 2 moves an L shape diagonally
crv = Curve(<curve referenced from the Rhino model>)
pt = Point(<point referenced from the Rhino model>)
crv_2 = Curve(<curve referenced from the Rhino model>)
pt_2 = Point(<point referenced from the Rhino model>)
shape = SGIShape(G=crv, refP=pt)  # -> S, G; inputs G: list, refP: Point3d
# ---------- shape: Python ----------
#
# SortalGI: A Sortal/Shape Grammar Interpreter Plugin
# 
# Copyright (c) 2018-2019, Rudi Stouffs <stouffs@sortal.org> 
# 
# SortalGI is free software; you can redistribute it and/or modify 
# it under the terms of the GNU General Public License as published 
# by the Free Software Foundation; either version 3 of the License, 
# or (at your option) any later version.
# 
# SortalGI is distributed in the hope that it will be useful,
# but WITHOUT ANY WARRANTY; without even the implied warranty of 
# MERCHANTABILITY or FITNESS FOR A PARTICULAR PURPOSE. See the 
# GNU General Public License for more details, <http://www.gnu.org/licenses/>.
# 
# @license GPL-3.0+ <http://spdx.org/licenses/GPL-3.0+>


"""
Create an SGI Shape object from geometry and an optional reference point.
-
Any part of the geometry not recognized will be ignored.
-
When specifying a reference point, the geometry will be moved from the reference point to the origin, allowing a shape that will serve as the left-hand-side or right-hand-side to a rule to be drawn or specified spatially separated from the other side of the rule.
-
    Args:
        G: Geometry (points, lines, polylines, (flat) surfaces, meshes, boundary representations, circles, ellipses, (circular) arcs, quadratic Bezier curves and/or text objects)
        refP: Optional reference point (geometry will be moved from reference point to origin)
    Returns:
        S: Resulting shape object
        G: Geometry of the shape object
"""

ghenv.Component.Name = 'SGI Shape'
ghenv.Component.NickName = 'Shape'
ghenv.Component.Message = 'VER 0.9.0\nDEC_15_2019'
ghenv.Component.Category = 'SGI'
ghenv.Component.SubCategory = '1 | Shape'

ghenv.Component.Params.Input[0].Name = 'G'
ghenv.Component.Params.Input[0].NickName = 'G'
ghenv.Component.Params.Input[0].Description = "Geometry (points, lines, polylines, (flat) surfaces, meshes, boundary representations, circles, ellipses, (circular) arcs, quadratic Bezier curves and/or text objects)"
ghenv.Component.Params.Input[1].Name = 'refP'
ghenv.Component.Params.Input[1].NickName = 'refP'
ghenv.Component.Params.Input[1].Description = "Optional reference point (geometry will be moved from reference point to origin)"
ghenv.Component.Params.Output[0].Name = 'S'
ghenv.Component.Params.Output[0].NickName = 'S'
ghenv.Component.Params.Output[0].Description = "Resulting shape object"
ghenv.Component.Params.Output[1].Name = 'G'
ghenv.Component.Params.Output[1].NickName = 'G'
ghenv.Component.Params.Output[1].Description = "Geometry of the shape object"

try: ghenv.Component.AdditionalHelpFromDocStrings = '1'
except: pass

__author__ = 'akidribm'

# Sortal imports
from sortal.io.rhinoGH import (RhinoShape, ExtractShape, DrawShape)
from sortal import sort

# System/Rhinoceros/Grasshopper library imports
import Rhino.Geometry as rg
import Rhino.DocObjects as rdo
import Rhino as r
import rhinoscriptsyntax as rs
import Grasshopper.Kernel as gh
import clr
import scriptcontext as sc
import System as sy

# Node-in-Code import
import ghpythonlib.components as ghcomp

w = gh.GH_RuntimeMessageLevel.Warning
e = gh.GH_RuntimeMessageLevel.Error

rhdoc = r.RhinoDoc.ActiveDoc

sgiName = 'sgi_' + ghdoc.Name
if sgiName[-1] == '*':
    sgiName = sgiName[:-1]

if sgiName in sc.sticky:
    validInputs = False

    if type(G) == type([]) and len(G) > 0:
        # Identifies if any geometries are unsupported by SGI Shape
        for i in G:
            if type(i) != rg.PolyCurve and type(i) != rg.PolylineCurve and type(i) != rg.LineCurve and type(i) != rg.Line and type(i) != rg.Brep and type(i) != rg.Mesh and type(i) != rg.Circle and type(i) != rg.Ellipse and type(i) != rg.NurbsCurve and type(i) != rg.ArcCurve and type(i) != rg.Rectangle3d and type(i) != rg.Point3d and type(i) != r.Display.Text3d and type(i) != TextGoo:
                ghenv.Component.AddRuntimeMessage(w, "Input contains unsupported geometries. You have inputted a "+ str(type(i)))
            else:
                validInputs = True
        if not validInputs:
            ghenv.Component.AddRuntimeMessage(e, "G must be a list of valid geometries")
    elif type(G) == type([]):
        validInputs = True

    if refP != None:
        if type(refP) != r.Geometry.Point3d:
            validInputs = False
            ghenv.Component.AddRuntimeMessage(e, "refP must be a point")

    if validInputs:
        # If refP given, adjusts refP input to create vector coordinates  
        # Original input geometry retained, as deleting them will cripple the entire GH operation
        # Preview of moved objects shown when Preview is turned on
        # Vector computed is from refP to origin
        if refP != None:
            transformVector = rg.Vector3d(-refP.X, -refP.Y, -refP.Z)
        
            for ind, thing in enumerate(G):
                try:
                    try:
                        rhinoObj = rhdoc.Objects.Find(thing)
                        T = rhinoObj.DisplayText
                        newOrigin = ghcomp.Move(rhinoObj.TextGeometry.Plane.Origin, transformVector)[0]
                        L = rg.Plane(newOrigin, rhinoObj.TextGeometry.Plane.Normal)
                    except: 
                        rhinoObj = thing
                        T = rhinoObj.Text
                        newOrigin = ghcomp.Move(rhinoObj.TextPlane.Origin, transformVector)[0]
                        L = rg.Plane(newOrigin, rhinoObj.TextPlane.Normal)
                
                    if rhinoObj == None:
                        ghenv.Component.AddRuntimeMessage(w, "The text you are trying to add may no longer exist in Rhino.")
                
                    H = sc.sticky[sgiName]['text_size']
                    displayObj = r.Display.Text3d(T, L, H)
                    #newObj = TextGoo(displayObj)
                    #tempList.append(rg.Point3d(L.Origin))
                    #G[ind] = newObj.DuplicateGeometry()
                    G[ind] = displayObj
                except:
                    G[ind] = ghcomp.Move(thing, transformVector)[0]
                    if G[ind] == None:
                        G[ind] = thing
            
        RS = ExtractShape(G, [], sc.sticky[sgiName]).toRhinoShape()
        RS = DrawShape(RS.form, sc.sticky[sgiName]).toRhinoShape()
        G = RS.geometry
        D = []
        S = RS

    elif validInputs:   
        RS = ExtractShape([], [], sc.sticky[sgiName]).toRhinoShape()
        G = RS.geometry
        D = []
        S = RS

else:
    ghenv.Component.AddRuntimeMessage(e, "Sortal library has not yet been set up. Please add the SGI Setup component.")
# ---------- end shape ----------
shape_2 = SGIShape(G=crv_2, refP=pt_2)  # -> S, G; inputs G: list, refP: Point3d; same code as shape
rule = SGIRule(name="rule_L_shape1", desc="moves L-shape down and to the left", lhS=shape.S, rhS=shape_2.S)  # -> rule
# ---------- rule: Python ----------
#
# SortalGI: A Sortal/Shape Grammar Interpreter Plugin
# 
# Copyright (c) 2018-2019, Rudi Stouffs <stouffs@sortal.org> 
# 
# SortalGI is free software; you can redistribute it and/or modify 
# it under the terms of the GNU General Public License as published 
# by the Free Software Foundation; either version 3 of the License, 
# or (at your option) any later version.
# 
# SortalGI is distributed in the hope that it will be useful,
# but WITHOUT ANY WARRANTY; without even the implied warranty of 
# MERCHANTABILITY or FITNESS FOR A PARTICULAR PURPOSE. See the 
# GNU General Public License for more details, <http://www.gnu.org/licenses/>.
# 
# @license GPL-3.0+ <http://spdx.org/licenses/GPL-3.0+>


"""
Create an SGI (non-parametric) Rule object from a left-hand-side and right-hand-side shape object, a rule name and a (optional) brief description.
-
A non-parametric rule will match a given shape if there exists a similarity transformation that matches the left-hand-side shape onto the given shape.
-
The rule name must be unique.
-
If a shape description type is present in one shape obejct (lhS or rhS) but not the other, an empty shape description of that type is automaticaly added to the other shape object within the rule.
-
    Args:
        name: Rule name (may contain only letters, digits and underscores, not starting with a digit)
        desc: Optional, brief rule description (text)
        lhS: Left-hand-side shape object
        rhS: Right-hand-side shape object
    Returns:
        rule: Non-parametric rule object
"""

ghenv.Component.Name = 'SGI Rule'
ghenv.Component.NickName = 'Rule'
ghenv.Component.Message = 'VER 0.9.0\nDEC_15_2019'
ghenv.Component.Category = "SGI"
ghenv.Component.SubCategory = "2 | Rule"

ghenv.Component.Params.Input[0].Name = "name"
ghenv.Component.Params.Input[0].NickName = "name"
ghenv.Component.Params.Input[0].Description = 'Rule name (may contain only letters, digits and underscores, not starting with a digit)'
ghenv.Component.Params.Input[1].Name = "desc"
ghenv.Component.Params.Input[1].NickName = "desc"
ghenv.Component.Params.Input[1].Description = 'Optional rule description (text)'
ghenv.Component.Params.Input[2].Name = "lhS"
ghenv.Component.Params.Input[2].NickName = "lhS"
ghenv.Component.Params.Input[2].Description = 'Left-hand-side shape object'
ghenv.Component.Params.Input[3].Name = "rhS"
ghenv.Component.Params.Input[3].NickName = "rhS"
ghenv.Component.Params.Input[3].Description = 'Right-hand-side shape object'
ghenv.Component.Params.Output[0].Name = "rule"
ghenv.Component.Params.Output[0].NickName = "rule"
ghenv.Component.Params.Output[0].Description = 'Non-parametric rule object'

try: ghenv.Component.AdditionalHelpFromDocStrings = "1"
except: pass

__author__ = "akidribm"

# Sortal imports
from sortal.io.rhinoGH import (RhinoShape, DrawShape)
from sortal import rule as ruleInstance

# System/Rhino/Grasshopper library imports
import System
import Rhino.Geometry as rg
import Rhino.DocObjects as rdo
import Rhino as r
import rhinoscriptsyntax as rs
import scriptcontext as sc
import Grasshopper.Kernel as gh
import clr

from future.utils import isidentifier

e = gh.GH_RuntimeMessageLevel.Error
w = gh.GH_RuntimeMessageLevel.Warning

rhdoc = r.RhinoDoc.ActiveDoc

rule = None

# Checks if inputs are correct data type
sgiName = 'sgi_' + ghdoc.Name
if sgiName[-1] == '*':
    sgiName = sgiName[:-1]

if sgiName in sc.sticky:
    validInputs = True

    if name is not None:
        if type(name) != type('a') or not isidentifier(name):
            validInputs = False
            ghenv.Component.AddRuntimeMessage(e, "name must be an identifier, containing only letters, digits and underscores, and not starting with a digit")
        else:
            # Checks if rule with the same name already exists in component form in Grasshopper
            check_rule_components = []
            for scriptObj in ghenv.Component.OnPingDocument().Objects:
                if ('SGI Rule' in scriptObj.Name or 'SGI pRule' in scriptObj.Name) and scriptObj.InstanceGuid != ghenv.Component.InstanceGuid:
                    check_rule_components.append(str(scriptObj.InstanceGuid))
            
            for guid_name in check_rule_components:
                if guid_name in sc.sticky[sgiName] and sc.sticky[sgiName][guid_name] == name:
                    validInputs = False
                    ghenv.Component.AddRuntimeMessage(e, "Another rule with the name '" + name + "' is already present in this Grasshopper file")

    if desc is not None and type(desc) != type('a'):
        validInputs = False
        ghenv.Component.AddRuntimeMessage(e, "desc must be a text string")

    if lhS is not None:
        try:
            if lhS.form.isEmpty():
                validInputs = False
                ghenv.Component.AddRuntimeMessage(e, "lhS cannot be an empty shape object")
            else:
                actualLHS = lhS.form.duplicate()
        except:
            validInputs = False
            ghenv.Component.AddRuntimeMessage(e, "lhS must be a shape object")

    if rhS is not None:
        try:
            if lhS.form is rhS.form:
                validInputs = False
                ghenv.Component.AddRuntimeMessage(e, "lhS and rhS cannot be the same shape object")
            else:
                actualRHS = rhS.form.duplicate()
        except:
            validInputs = False
            ghenv.Component.AddRuntimeMessage(e, "rhS must be a shape object")

    if name is not None and lhS is not None and rhS is not None and validInputs:
        sc.sticky[sgiName][str(ghenv.Component.InstanceGuid)] = name

        # Checks if rule with the same name already exists in the rule register
        # If found, removes the rule from the register
        if name in ruleInstance.register:
            del ruleInstance.register[name]
        
        try:
            #if lhS.shape.sort.contains(rhS.shape.sort):
            #    actualRHS = shift_metaform(lhS.shape.sort, rhS.shape)
            #elif rhS.shape.sort.contains(lhS.shape.sort):
            #    actualLHS = shift_metaform(rhS.shape.sort, lhS.shape)
            #else:
            #    newDisjSort = make_composite_sort(lhS.shape.sort,rhS.shape.sort)
            #    actualRHS = shift_metaform(newDisjSort, rhS.shape)
            #    actualLHS = shift_metaform(newDisjSort, lhS.shape)
            print(actualLHS.toString('',True))
            print(actualRHS.toString('',True))

            rule = ruleInstance(name, desc, actualLHS, actualRHS, keyCheck = True)

            if rule.isValid():
                print name, 'has been created.'
                # Reruns GH file if rule has been altered
                for scriptObj in ghenv.Component.OnPingDocument().Objects:
                    if 'SGI Get Rule' in scriptObj.Name or 'SGI All Rules' in scriptObj.Name:
                        scriptObj.ExpireSolution(True)

            else:
                message = ('Rule was not created since there was insufficient information for LHS Shape.\n'+
                           'The minimum requirements for defining the LHS of a non-parametric rule are:\n'+
                           '- minimally 3 points (not coincident)\n'+
                           '- minimally 2 points + 1 plane (points not co-linear to perpendicular)\n'+
                           '- minimally 1 point + 2 planes (not concurrent)\n'+
                           '- minimally 1 point + 1 arc (point not perpendicular to arc center)\n'+
                           '- minimally 1 point + 1 line (not co-linear)\n'+
                           '- minimally 1 point + 1 line + 1 plane (not coincident nor perpendicular)\n'+
                           '- minimally 3 lines (not all parallel)\n'+
                           '- minimally 2 lines + 1 plane (not all parellel, nor both lines concurrent to plane)\n'+
                           '- minimally 1 line + 2 planes (line not concurrent to both planes)\n'+
                           '- minimally 1 line + 1 arc (center not co-linear)\n'+
                           '- minimally 2 arcs (not concentric or normals not parallel)\n'+
                           '- minimally 4 planes (not all parallel, nor all lines of intersection parallel, concurent or coincident)\n'+
                           '- exactly 1 or 2 points and nothing else\n'+
                           '- exactly 1 or 2 lines and nothing else\n'+
                           '- exactly 1 line and 1 co-linear point and nothing else')
                                    
                ghenv.Component.AddRuntimeMessage(e, message)
        except:
            ghenv.Component.AddRuntimeMessage(e, 'Rule was not created. One or more of the inputs may be invalid.')

else:
    ghenv.Component.AddRuntimeMessage(e, "Sortal library has not yet been set up. Please add the SGI Setup component.")
# ---------- end rule ----------

# ---- group: Shape grammar design (using SortalGI) / Rule 1 moves a square diagonally
crv_3 = Curve(<curve referenced from the Rhino model>)
pt_3 = Point(<point referenced from the Rhino model>)
crv_4 = Curve(<curve referenced from the Rhino model>)
pt_4 = Point(<point referenced from the Rhino model>)
shape_3 = SGIShape(G=crv_4, refP=pt_4)  # -> S, G; inputs G: list, refP: Point3d; same code as shape
shape_4 = SGIShape(G=crv_3, refP=pt_3)  # -> S, G; inputs G: list, refP: Point3d; same code as shape
rule_2 = SGIRule(name="rule_square1", desc="moves square up and to the right", lhS=shape_4.S, rhS=shape_3.S)  # -> rule; same code as rule

# ---- group: Shape grammar design (using SortalGI) / Shape grammar design option generation 1
crv_5 = Curve([<curve referenced from the Rhino model> x2])
crv_6 = Curve([<curve referenced from the Rhino model> x2])
shape_5 = SGIShape(G=crv_5)  # -> S, G; inputs G: list, refP: Point3d; same code as shape
shape_6 = SGIShape(G=crv_6)  # -> S, G; inputs G: list, refP: Point3d; same code as shape
get_rule = SGIGetRule(name="rule_L_shape1")  # -> rule
# ---------- get_rule: Python ----------
#
# SortalGI: A Sortal/Shape Grammar Interpreter Plugin
# 
# Copyright (c) 2018-2019, Rudi Stouffs <stouffs@sortal.org> 
# 
# SortalGI is free software; you can redistribute it and/or modify 
# it under the terms of the GNU General Public License as published 
# by the Free Software Foundation; either version 3 of the License, 
# or (at your option) any later version.
# 
# SortalGI is distributed in the hope that it will be useful,
# but WITHOUT ANY WARRANTY; without even the implied warranty of 
# MERCHANTABILITY or FITNESS FOR A PARTICULAR PURPOSE. See the 
# GNU General Public License for more details, <http://www.gnu.org/licenses/>.
# 
# @license GPL-3.0+ <http://spdx.org/licenses/GPL-3.0+>


"""
Retrieve an SGI Rule (or pRule) object by its name.
-
    Args:
        name: Rule name
    Returns:
        rule: (non-parametric or parametric-associative) Rule object (or Null)
"""

ghenv.Component.Name = 'SGI Get Rule'
ghenv.Component.NickName = 'Get Rule'
ghenv.Component.Message = 'VER 0.9.0\nDEC_15_2019'
ghenv.Component.Category = "SGI"
ghenv.Component.SubCategory = "2 | Rule"

ghenv.Component.Params.Input[0].Name = "name"
ghenv.Component.Params.Input[0].NickName = "name"
ghenv.Component.Params.Input[0].Description = 'Rule name'
ghenv.Component.Params.Output[0].Name = "rule"
ghenv.Component.Params.Output[0].NickName = "rule"
ghenv.Component.Params.Output[0].Description = '(non-parametric or parametric-associative) Rule object (or Null)'

try: ghenv.Component.AdditionalHelpFromDocStrings = "1"
except: pass

__author__ = "akidribm"

import rhinoscriptsyntax as rs
from sortal import (transformSet, primitiveSort, point3D, point2D, coordinate, lineSegment3D, planeSegment2D, 
                    lineSegment2D, line3D, label, rWeight, disjunctiveSort, attributeSort, affineTransform,  
                    vector3D, vector2D, planeSegment3D, affineTransform3D, plane3D, sort)
from sortal import rule as sortalRule

import Rhino.Geometry as rg
import Rhino.DocObjects as rdo
import Rhino as r
import rhinoscriptsyntax as rs
import scriptcontext as sc
import Grasshopper.Kernel as gh
import System as sy
import clr

e = gh.GH_RuntimeMessageLevel.Error
w = gh.GH_RuntimeMessageLevel.Warning

rhdoc = r.RhinoDoc.ActiveDoc

# Node-in-Code import
import ghpythonlib.components as ghcomp

rule = []

sgiName = 'sgi_' + ghdoc.Name
if sgiName[-1] == '*':
    sgiName = sgiName[:-1]

if sgiName in sc.sticky:
    if name != None:
        if type(name) == type('a'):
            if '\r\n' in name:
                name = name.split('\r\n')
        if type(name) == type([]) and len(name) == 1:
            if '\r\n' in name[0]:
                name = name[0].split('\r\n')

        if type(name) == type([]):
            for rule_name in name:
                if rule_name != '':
                    check = False
                    for register_name in sortalRule.register:
                        if register_name == rule_name or register_name.startswith(rule_name + "___"):
                            rule.append(sortalRule.register[register_name])
                            check = True
                            break
                    
                    if check == False:
                        ghenv.Component.AddRuntimeMessage(w, "The rule " + rule_name + " is not present in the sortal rule register")
        elif name != '':
            check = False
            for register_name in sortalRule.register:
                if register_name == name or register_name.startswith(name + "___"):
                    rule = sortalRule.register[register_name]
                    check = True
                    break
                        
            if check == False:
                ghenv.Component.AddRuntimeMessage(w, "The rule " + name + " is not present in the sortal rule register")

else:
    ghenv.Component.AddRuntimeMessage(e, 'Sortal library has not yet been set up. Please add the SGI Setup component.')
# ---------- end get_rule ----------
get_rule_2 = SGIGetRule(name="rule_square1")  # -> rule; same code as get_rule
apply = SGIApply(rule=get_rule, S=shape_5.S, subS=shape_6.S, i="0")  # -> S, G, D, T, success; inputs i: Int32
# ---------- apply: Python ----------
#
# SortalGI: A Sortal/Shape Grammar Interpreter Plugin
# 
# Copyright (c) 2018-2019, Rudi Stouffs <stouffs@sortal.org> 
# 
# SortalGI is free software; you can redistribute it and/or modify 
# it under the terms of the GNU General Public License as published 
# by the Free Software Foundation; either version 3 of the License, 
# or (at your option) any later version.
# 
# SortalGI is distributed in the hope that it will be useful,
# but WITHOUT ANY WARRANTY; without even the implied warranty of 
# MERCHANTABILITY or FITNESS FOR A PARTICULAR PURPOSE. See the 
# GNU General Public License for more details, <http://www.gnu.org/licenses/>.
# 
# @license GPL-3.0+ <http://spdx.org/licenses/GPL-3.0+>


"""
Apply an SGI Rule (or pRule) object onto a shape. If a subshape is additionally specified then the matching is performed 
on the subshape to narrow down the potential rule applications. In the case of multiple potential rule applications, the 
index value is used to select the rule application from the potential list. An index value of -1 results in a random selection.
-
The component's output consists of the shape resulting from rule application, its geometry, its shape descriptions, a 
translation vector that can be used to move/displace the resulting shape wrt the original shape, and an indication of 
success. Note that if the rule cannot be applied, the original shape is returned.
-
The x-coordinate of the translation vector is controlled by the displacementX input to the SGI Setup node. The other coordinates are zero.
-
    Args:
        rule: Rule object
        S: Shape object to apply the rule to
        subS: Optional sub-shape object to restrict matches to
        i: Optional index number of rule application; default value of -1 results in a random selection
    Returns:
        S: Resulting shape object from rule application
        G: Geometry of the resulting shape object
        D: Shape descriptions of the resulting shape object
        T: Translation vector that can be used to move/displace the resulting shape wrt the original shape
        success: True or False indicating whether a rule application exists
"""

ghenv.Component.Name = 'SGI Apply'
ghenv.Component.NickName = 'Apply'
ghenv.Component.Message = 'VER 0.9.0\nDEC_15_2019'
ghenv.Component.Category = "SGI"
ghenv.Component.SubCategory = "2 | Rule"

ghenv.Component.Params.Input[0].Name = "rule"
ghenv.Component.Params.Input[0].NickName = "rule"
ghenv.Component.Params.Input[0].Description = 'Rule object'
ghenv.Component.Params.Input[1].Name = "S"
ghenv.Component.Params.Input[1].NickName = "S"
ghenv.Component.Params.Input[1].Description = 'Shape object to apply the rule to'
ghenv.Component.Params.Input[2].Name = "subS"
ghenv.Component.Params.Input[2].NickName = "subS"
ghenv.Component.Params.Input[2].Description = 'Optional sub-shape object to restrict matches to'
ghenv.Component.Params.Input[3].Name = "i"
ghenv.Component.Params.Input[3].NickName = "i"
ghenv.Component.Params.Input[3].Description = 'Optional index number of rule application; default value of -1 results in a random selection'
ghenv.Component.Params.Output[0].Name = "S"
ghenv.Component.Params.Output[0].NickName = "S"
ghenv.Component.Params.Output[0].Description = 'Resulting shape object from rule application'
ghenv.Component.Params.Output[1].Name = "G"
ghenv.Component.Params.Output[1].NickName = "G"
ghenv.Component.Params.Output[1].Description = 'Geometry of the resulting shape object'
ghenv.Component.Params.Output[2].Name = "D"
ghenv.Component.Params.Output[2].NickName = "D"
ghenv.Component.Params.Output[2].Description = 'Shape descriptions of the resulting shape object'
ghenv.Component.Params.Output[3].Name = "T"
ghenv.Component.Params.Output[3].NickName = "T"
ghenv.Component.Params.Output[3].Description = 'Translation vector that can be used to move/displace the resulting shape wrt the original shape'
ghenv.Component.Params.Output[4].Name = "success"
ghenv.Component.Params.Output[4].NickName = "success"
ghenv.Component.Params.Output[4].Description = 'True or False indicating whether a rule application exists'

try: ghenv.Component.AdditionalHelpFromDocStrings = "1"
except: pass

__author__ = "akidribm"

# Sortal imports
from sortal.io.rhinoGH import (RhinoShape, ConvertShape, DrawShape)
from sortal import rule as ruleInstance

# System/Rhinoceros/Grasshopper library imports
import System as sy     
import Rhino.Geometry as rg
import Rhino.DocObjects as rdo
import Rhino as r
import Grasshopper.Kernel as gh
import rhinoscriptsyntax as rs
import clr
import scriptcontext as sc

import random

rhdoc = r.RhinoDoc.ActiveDoc

e = gh.GH_RuntimeMessageLevel.Error
w = gh.GH_RuntimeMessageLevel.Warning

sgiName = 'sgi_' + ghdoc.Name
if sgiName[-1] == '*':
    sgiName = sgiName[:-1]

if sgiName in sc.sticky:
    validInputs = True

    if rule is not None:
        if not isinstance(rule, ruleInstance):
            validInputs = False
            ghenv.Component.AddRuntimeMessage(e, "rule must be a rule object")

    if S is not None:
        try:
            mainShape = S.form
        except:
            validInputs = False
            ghenv.Component.AddRuntimeMessage(e, "S must be a shape object")

    if subS is not None:
        try:
            subShape = subS.form
            if validInputs and not subShape.partOf(mainShape):
                validInputs = False
                ghenv.Component.AddRuntimeMessage(e, "subS is not a subshape of S")
        except:
            validInputs = False
            ghenv.Component.AddRuntimeMessage(e, "subS must be a shape object")

    if i is not None and type(i) != type(1):
        validInputs = False
        ghenv.Component.AddRuntimeMessage(e, "i must be an integer value")
    
    if rule is not None and S is not None and validInputs:
        success = [False]
        
        if ConvertShape.checkParametric(rule.lhs):
            mainShape, mainExclusion = ConvertShape(mainShape, [], sc.sticky[sgiName]).toConverseForm()    # Collects circular/elliptical arc forms for reinsertion during P to NP conversion
            if subS is not None:
                subShape, subExclusion = ConvertShape(subShape, [], sc.sticky[sgiName]).toConverseForm()
        else:
            mainShape = mainShape.duplicate()
            if subS is not None:
                subShape = subShape.duplicate()

        shapeSort = mainShape.sort
        remainderShape = None 
        if shapeSort is rule.lhs.sort:
            pass
        elif shapeSort.contains(rule.lhs.sort):
            remainderSort = shapeSort.complementSort(rule.lhs.sort)
            mainShape, remainderShape = mainShape.splitSort(rule.lhs.sort, remainderSort)
            if subS is not None:
                subShape, remainderSubShape = subShape.splitSort(rule.lhs.sort, remainderSort)
        else:
            mainShape = mainShape.switchSort(rule.lhs.sort)
            if subS is not None:
                subShape = subShape.switchSort(rule.lhs.sort)

        print(rule.lhs.toString('',True))
        if ConvertShape.checkParametric(rule.lhs):
            print(rule.getPredicates())
        print(rule.rhs.toString('',True))
        if ConvertShape.checkParametric(rule.lhs):
            print(rule.getDirectives())
        print(mainShape.toString('',True))
        
        if subS is not None:
            print(subShape.toString('',True))

            rule.detection.applicationDict[rule.name] = []
            ruleAppns = rule.detect(subShape)
            limit = len(ruleAppns)
        else:
            rule.detection.applicationDict[rule.name] = []
            ruleAppns = rule.detect(mainShape)
            limit = len(ruleAppns)
    
        # Checks if any matches are generated
        if limit > 0:
            success = [True]
                
            # Generates vector T for S.geometry
            G = S.geometry
            if G == []:
                RS = DrawShape(mainShape, sc.sticky[sgiName]).toRhinoShape()
                G = RS.geometry

            bbox = DrawShape.get_bbox(G)
            # Generates starting coordinates for vector T
            if sc.sticky[sgiName]['displacementX'] == False and bbox != None:
                start_distance_x = (bbox[1].X- bbox[0].X)*sc.sticky['sgi_fixed_factor']
            else:
                start_distance_x = sc.sticky[sgiName]['displacementX']
            if start_distance_x == 0.0:
                start_distance_x = 5
            T = rg.Vector3d(start_distance_x, 0.0, 0.0)
            
            # Applies random single application onto initial shape
            if i < 0:
                # Selects a randpm rule application
                choice = random.randint(0, limit-1)
                # Applies chosen single application (0 index) onto initial shape
            else:
                # Mods choice number to get remainder over limit
                choice = i%limit

            # Performs rule application onto shape
            S2Shape = ruleAppns[choice].perform(mainShape)

            # Updates S.geometry
            if remainderShape != None:
                S2Shape = remainderShape.mergeSort(S2Shape, shapeSort)
            elif not S2Shape.sort is shapeSort:
                remainderSort = S2Shape.sort.complementSort(shapeSort)
                S2Shape, remainderShape = S2Shape.splitSort(shapeSort, remainderSort)
            
            # Converts mainShape from P to NP
            if ConvertShape.checkParametric(rule.lhs):
                S2Shape, exclusion = ConvertShape(S2Shape, mainExclusion, sc.sticky[sgiName]).toConverseForm()

            # Generates result geometry
            RS = DrawShape(S2Shape, sc.sticky[sgiName]).toRhinoShape()
            G = RS.geometry
            #G = flatten(G)  # flattens list of geometry to extract labelled description points
            D = RS.descriptions
            S = RS
                
            print(mainShape.toString('',True))

        else:
            ghenv.Component.AddRuntimeMessage(w, "No rule applications detected")
            T = rg.Vector3d(0, 0, 0)
            if S.form.isEmpty():
                G = []
                D = []
            elif S.geometry != [] or S.descriptions != []:
                G = S.geometry
                D = S.descriptions
            else:
                # Draws geometry correspondign to shape
                RS = DrawShape(S.form, sc.sticky[sgiName]).toRhinoShape()
                G = RS.geometry
                D = RS.descriptions

else:
    ghenv.Component.AddRuntimeMessage(e, "Sortal library has not yet been set up. Please add the SGI Setup component.")
# ---------- end apply ----------
move_shape = SGIMoveShape(S=apply.S, T=apply.T)  # -> S, G, D; inputs T: Vector3d
# ---------- move_shape: Python ----------
#
# SortalGI: A Sortal/Shape Grammar Interpreter Plugin
# 
# Copyright (c) 2018-2019, Rudi Stouffs <stouffs@sortal.org> 
# 
# SortalGI is free software; you can redistribute it and/or modify 
# it under the terms of the GNU General Public License as published 
# by the Free Software Foundation; either version 3 of the License, 
# or (at your option) any later version.
# 
# SortalGI is distributed in the hope that it will be useful,
# but WITHOUT ANY WARRANTY; without even the implied warranty of 
# MERCHANTABILITY or FITNESS FOR A PARTICULAR PURPOSE. See the 
# GNU General Public License for more details, <http://www.gnu.org/licenses/>.
# 
# @license GPL-3.0+ <http://spdx.org/licenses/GPL-3.0+>


"""
Move an SGI Shape object along a translation vector
-
The translation vector may result from a rule application and allows the resulting shape not to overlap and be properly spaced wrt the original shape
-
    Args:
        S: Shape object
        T: Translation vector
    Returns:
        S: Translated shape object
        G: Geometry of the translated shape object
        D: Shape descriptions of the translated shape object
"""

ghenv.Component.Name = 'SGI Move Shape'
ghenv.Component.NickName = 'Move Shape'
ghenv.Component.Message = 'VER 0.9.0\nDEC_15_2019'
ghenv.Component.Category = "SGI"
ghenv.Component.SubCategory = "1 | Shape"

ghenv.Component.Params.Input[0].Name = "S"
ghenv.Component.Params.Input[0].NickName = "S"
ghenv.Component.Params.Input[0].Description = 'Shape object'
ghenv.Component.Params.Input[1].Name = "T"
ghenv.Component.Params.Input[1].NickName = "T"
ghenv.Component.Params.Input[1].Description = 'Translation vector'
ghenv.Component.Params.Output[0].Name = "S"
ghenv.Component.Params.Output[0].NickName = "S"
ghenv.Component.Params.Output[0].Description = 'Translated shape object'
ghenv.Component.Params.Output[1].Name = "G"
ghenv.Component.Params.Output[1].NickName = "G"
ghenv.Component.Params.Output[1].Description = 'Geometry of the translated shape object'
ghenv.Component.Params.Output[2].Name = "D"
ghenv.Component.Params.Output[2].NickName = "D"
ghenv.Component.Params.Output[2].Description = 'Shape descriptions of the translated shape object'

try: ghenv.Component.AdditionalHelpFromDocStrings = "1"
except: pass

__author__ = "akidribm"

# Sortal imports
from sortal.io.rhinoGH import (RhinoShape, DrawShape)
from sortal import (form, vector3D, transformSet, affineTransform3D)

# System/Rhinoceros/Grasshopper library imports
import Rhino.Geometry as rg
import Rhino.DocObjects as rdo
import Rhino as r
import rhinoscriptsyntax as rs
import scriptcontext as sc
import Grasshopper.Kernel as gh
import System as sy
import clr

from math import pi

e = gh.GH_RuntimeMessageLevel.Error
w = gh.GH_RuntimeMessageLevel.Warning

rhdoc = r.RhinoDoc.ActiveDoc

# to fit all transformation matrices into one transformSet, combine them:
#          e.g. combinedMatrix = translationMatrix.combine(scalingMatrix).combine(rotationMatrix)
#               tfSet.add(combinedMatrix)
#
# same for 3D except rotating:
#       rotationMatrix = affineTransform3D.rotation(vector, sinSq, cos)  
# vector is the direction of rotation, sinSq: sin square of the rotating angle, cos: cos of the rotating angle

sgiName = 'sgi_' + ghdoc.Name
if sgiName[-1] == '*':
    sgiName = sgiName[:-1]

if sgiName in sc.sticky:
    validInputs = True

    if S is not None:
        try:
            Sshape = S.form.duplicate()
        except:
            validInputs = False
            ghenv.Component.AddRuntimeMessage(e, "S must be a shape object")

    if T != None:
        try:
            if type(T) == type([]):
                translationVector = vector3D(T[0], T[1], T[2])
            else:
                translationVector = vector3D(T.X, T.Y, T.Z)
        except:
            validInputs = False
            ghenv.Component.AddRuntimeMessage(e, "T must be a vector or a triple of numbers")

    if S is not None and T != None and validInputs:
        translationMatrix = affineTransform3D.translation(translationVector)
        translationMatrix.id = Sshape.sort.name
        tfSet = transformSet()
        tfSet.add(translationMatrix)
        
        Sshape = Sshape.transform(tfSet)

        RS = DrawShape(Sshape, sc.sticky[sgiName]).toRhinoShape()
        G = RS.geometry
        D = RS.descriptions
        S = RS
    else:
        S = None
else:
    ghenv.Component.AddRuntimeMessage(e, "Sortal library has not yet been set up. Please add the SGI Setup component.")
# ---------- end move_shape ----------
apply_2 = SGIApply(rule=get_rule_2, S=move_shape.S, i="4")  # -> S, G, D, T, success; inputs i: Int32; same code as apply
move_shape_2 = SGIMoveShape(S=apply_2.S, T=apply_2.T)  # -> S, G, D; inputs T: Vector3d; same code as move_shape
apply_3 = SGIApply(rule=get_rule, S=move_shape_2.S, i="0")  # -> S, G, D, T, success; inputs i: Int32; same code as apply
move_shape_3 = SGIMoveShape(S=apply_3.S, T=apply_3.T)  # -> S, G, D; inputs T: Vector3d; same code as move_shape
apply_4 = SGIApply(rule=get_rule, S=move_shape_3.S, i="0")  # -> S, G, D, T, success; inputs i: Int32; same code as apply
move_shape_4 = SGIMoveShape(S=apply_4.S, T=apply_4.T)  # -> S, G, D; inputs T: Vector3d; same code as move_shape
apply_5 = SGIApply(rule=get_rule_2, S=move_shape_4.S, i="5")  # -> S, G, D, T, success; inputs i: Int32; same code as apply
move_shape_5 = SGIMoveShape(S=apply_5.S, T=apply_5.T)  # -> S, G, D; inputs T: Vector3d; same code as move_shape

# ---- group: Shape grammar design (using SortalGI) / Shape grammar design option generation 4
crv_7 = Curve([<curve referenced from the Rhino model> x2])
crv_8 = Curve([<curve referenced from the Rhino model> x2])
shape_7 = SGIShape(G=crv_7)  # -> S, G; inputs G: list, refP: Point3d; same code as shape
shape_8 = SGIShape(G=crv_8)  # -> S, G; inputs G: list, refP: Point3d; same code as shape
get_rule_3 = SGIGetRule(name="rule_L_shape1")  # -> rule; same code as get_rule
get_rule_4 = SGIGetRule(name="rule_square1")  # -> rule; same code as get_rule
apply_6 = SGIApply(rule=get_rule_3, S=shape_7.S, subS=shape_8.S, i="0")  # -> S, G, D, T, success; inputs i: Int32; same code as apply
move_shape_6 = SGIMoveShape(S=apply_6.S, T=apply_6.T)  # -> S, G, D; inputs T: Vector3d; same code as move_shape
apply_7 = SGIApply(rule=get_rule_4, S=move_shape_6.S, i="3")  # -> S, G, D, T, success; inputs i: Int32; same code as apply
move_shape_7 = SGIMoveShape(S=apply_7.S, T=apply_7.T)  # -> S, G, D; inputs T: Vector3d; same code as move_shape
apply_8 = SGIApply(rule=get_rule_4, S=move_shape_7.S, i="4")  # -> S, G, D, T, success; inputs i: Int32; same code as apply
move_shape_8 = SGIMoveShape(S=apply_8.S, T=apply_8.T)  # -> S, G, D; inputs T: Vector3d; same code as move_shape
apply_9 = SGIApply(rule=get_rule_4, S=move_shape_8.S, i="1")  # -> S, G, D, T, success; inputs i: Int32; same code as apply
move_shape_9 = SGIMoveShape(S=apply_9.S, T=apply_9.T)  # -> S, G, D; inputs T: Vector3d; same code as move_shape
apply_10 = SGIApply(rule=get_rule_4, S=move_shape_9.S, i="0")  # -> S, G, D, T, success; inputs i: Int32; same code as apply
move_shape_10 = SGIMoveShape(S=apply_10.S, T=apply_10.T)  # -> S, G, D; inputs T: Vector3d; same code as move_shape

# ---- group: Shape grammar design (using SortalGI) / Shape grammar design option generation 2
crv_9 = Curve([<curve referenced from the Rhino model> x2])
crv_10 = Curve([<curve referenced from the Rhino model> x2])
shape_9 = SGIShape(G=crv_9)  # -> S, G; inputs G: list, refP: Point3d; same code as shape
shape_10 = SGIShape(G=crv_10)  # -> S, G; inputs G: list, refP: Point3d; same code as shape
get_rule_5 = SGIGetRule(name="rule_L_shape1")  # -> rule; same code as get_rule
get_rule_6 = SGIGetRule(name="rule_square1")  # -> rule; same code as get_rule
apply_11 = SGIApply(rule=get_rule_5, S=shape_9.S, subS=shape_10.S, i="0")  # -> S, G, D, T, success; inputs i: Int32; same code as apply
move_shape_11 = SGIMoveShape(S=apply_11.S, T=apply_11.T)  # -> S, G, D; inputs T: Vector3d; same code as move_shape
apply_12 = SGIApply(rule=get_rule_6, S=move_shape_11.S, i="7")  # -> S, G, D, T, success; inputs i: Int32; same code as apply
move_shape_12 = SGIMoveShape(S=apply_12.S, T=apply_12.T)  # -> S, G, D; inputs T: Vector3d; same code as move_shape
apply_13 = SGIApply(rule=get_rule_5, S=move_shape_12.S, i="3")  # -> S, G, D, T, success; inputs i: Int32; same code as apply
move_shape_13 = SGIMoveShape(S=apply_13.S, T=apply_13.T)  # -> S, G, D; inputs T: Vector3d; same code as move_shape
apply_14 = SGIApply(rule=get_rule_6, S=move_shape_13.S, i="2")  # -> S, G, D, T, success; inputs i: Int32; same code as apply
move_shape_14 = SGIMoveShape(S=apply_14.S, T=apply_14.T)  # -> S, G, D; inputs T: Vector3d; same code as move_shape
apply_15 = SGIApply(rule=get_rule_6, S=move_shape_14.S, i="5")  # -> S, G, D, T, success; inputs i: Int32; same code as apply
move_shape_15 = SGIMoveShape(S=apply_15.S, T=apply_15.T)  # -> S, G, D; inputs T: Vector3d; same code as move_shape

# ---- group: Shape grammar design (using SortalGI) / Shape grammar design option generation 0
crv_11 = Curve([<curve referenced from the Rhino model> x2])
crv_12 = Curve([<curve referenced from the Rhino model> x2])
shape_11 = SGIShape(G=crv_11)  # -> S, G; inputs G: list, refP: Point3d; same code as shape
shape_12 = SGIShape(G=crv_12)  # -> S, G; inputs G: list, refP: Point3d; same code as shape
get_rule_7 = SGIGetRule(name="rule_L_shape1")  # -> rule; same code as get_rule
get_rule_8 = SGIGetRule(name="rule_square1")  # -> rule; same code as get_rule
apply_16 = SGIApply(rule=get_rule_7, S=shape_11.S, subS=shape_12.S, i="0")  # -> S, G, D, T, success; inputs i: Int32; same code as apply
move_shape_16 = SGIMoveShape(S=apply_16.S, T=apply_16.T)  # -> S, G, D; inputs T: Vector3d; same code as move_shape
apply_17 = SGIApply(rule=get_rule_8, S=move_shape_16.S, i="6")  # -> S, G, D, T, success; inputs i: Int32; same code as apply
move_shape_17 = SGIMoveShape(S=apply_17.S, T=apply_17.T)  # -> S, G, D; inputs T: Vector3d; same code as move_shape
apply_18 = SGIApply(rule=get_rule_7, S=move_shape_17.S, i="0")  # -> S, G, D, T, success; inputs i: Int32; same code as apply
move_shape_18 = SGIMoveShape(S=apply_18.S, T=apply_18.T)  # -> S, G, D; inputs T: Vector3d; same code as move_shape
apply_19 = SGIApply(rule=get_rule_7, S=move_shape_18.S, i="0")  # -> S, G, D, T, success; inputs i: Int32; same code as apply
move_shape_19 = SGIMoveShape(S=apply_19.S, T=apply_19.T)  # -> S, G, D; inputs T: Vector3d; same code as move_shape
apply_20 = SGIApply(rule=get_rule_8, S=move_shape_19.S, i="5")  # -> S, G, D, T, success; inputs i: Int32; same code as apply
move_shape_20 = SGIMoveShape(S=apply_20.S, T=apply_20.T)  # -> S, G, D; inputs T: Vector3d; same code as move_shape

# ---- group: Shape grammar design (using SortalGI) / Shape grammar design option generation 3
crv_13 = Curve([<curve referenced from the Rhino model> x2])
crv_14 = Curve([<curve referenced from the Rhino model> x2])
shape_13 = SGIShape(G=crv_13)  # -> S, G; inputs G: list, refP: Point3d; same code as shape
shape_14 = SGIShape(G=crv_14)  # -> S, G; inputs G: list, refP: Point3d; same code as shape
get_rule_9 = SGIGetRule(name="rule_L_shape1")  # -> rule; same code as get_rule
get_rule_10 = SGIGetRule(name="rule_square1")  # -> rule; same code as get_rule
apply_21 = SGIApply(rule=get_rule_9, S=shape_13.S, subS=shape_14.S, i="0")  # -> S, G, D, T, success; inputs i: Int32; same code as apply
move_shape_21 = SGIMoveShape(S=apply_21.S, T=apply_21.T)  # -> S, G, D; inputs T: Vector3d; same code as move_shape
apply_22 = SGIApply(rule=get_rule_10, S=move_shape_21.S, i="1")  # -> S, G, D, T, success; inputs i: Int32; same code as apply
move_shape_22 = SGIMoveShape(S=apply_22.S, T=apply_22.T)  # -> S, G, D; inputs T: Vector3d; same code as move_shape
apply_23 = SGIApply(rule=get_rule_10, S=move_shape_22.S, i="7")  # -> S, G, D, T, success; inputs i: Int32; same code as apply
move_shape_23 = SGIMoveShape(S=apply_23.S, T=apply_23.T)  # -> S, G, D; inputs T: Vector3d; same code as move_shape
apply_24 = SGIApply(rule=get_rule_10, S=move_shape_23.S, i="4")  # -> S, G, D, T, success; inputs i: Int32; same code as apply
move_shape_24 = SGIMoveShape(S=apply_24.S, T=apply_24.T)  # -> S, G, D; inputs T: Vector3d; same code as move_shape
apply_25 = SGIApply(rule=get_rule_10, S=move_shape_24.S, i="1")  # -> S, G, D, T, success; inputs i: Int32; same code as apply
move_shape_25 = SGIMoveShape(S=apply_25.S, T=apply_25.T)  # -> S, G, D; inputs T: Vector3d; same code as move_shape

# ---- group: Shape grammar design (using SortalGI) / Design option 2 building outline
boundary = BoundarySurfaces(Edges=move_shape_15.G)
sunion = SolidUnion(Breps=boundary)
edges = BrepEdges(Brep=sunion)  # -> Naked, Interior, NonManifold
X = UnitX(Factor="56000")
move = Move(Geometry=edges.Naked, Motion=X)  # -> Geometry, Transform
join = JoinCurves(Curves=move.Geometry, Preserve=False)

# ---- group: Shape grammar design (using SortalGI) / Design option 4 building outline
boundary_2 = BoundarySurfaces(Edges=move_shape_10.G)
sunion_2 = SolidUnion(Breps=boundary_2)
edges_2 = BrepEdges(Brep=sunion_2)  # -> Naked, Interior, NonManifold
X_2 = UnitX(Factor="56000")
move_2 = Move(Geometry=edges_2.Naked, Motion=X_2)  # -> Geometry, Transform
join_2 = JoinCurves(Curves=move_2.Geometry, Preserve=False)

# ---- group: Shape grammar design (using SortalGI) / Design option 3 building outline
boundary_3 = BoundarySurfaces(Edges=move_shape_25.G)
sunion_3 = SolidUnion(Breps=boundary_3)
edges_3 = BrepEdges(Brep=sunion_3)  # -> Naked, Interior, NonManifold
X_3 = UnitX(Factor="56000")
move_3 = Move(Geometry=edges_3.Naked, Motion=X_3)  # -> Geometry, Transform
join_3 = JoinCurves(Curves=move_3.Geometry, Preserve=False)

# ---- group: Shape grammar design (using SortalGI)
pt_5 = Point(<point referenced from the Rhino model>)
multiplication = Multiplication(A="56000", B="6")
X_4 = UnitX(Factor=multiplication)
move_4 = Move(Geometry=pt_5, Motion=X_4)  # -> Geometry, Transform

pt_6 = Point(<point referenced from the Rhino model>)
multiplication_2 = Multiplication(A="56000", B="6")
X_5 = UnitX(Factor=multiplication_2)
move_5 = Move(Geometry=pt_6, Motion=X_5)  # -> Geometry, Transform

pt_7 = Point(<point referenced from the Rhino model>)
multiplication_3 = Multiplication(A="56000", B="6")
X_6 = UnitX(Factor=multiplication_3)
move_6 = Move(Geometry=pt_7, Motion=X_6)  # -> Geometry, Transform

# ---- group: Shape grammar design (using SortalGI) / Design option 0 building outline
boundary_4 = BoundarySurfaces(Edges=move_shape_20.G)
sunion_4 = SolidUnion(Breps=boundary_4)
edges_4 = BrepEdges(Brep=sunion_4)  # -> Naked, Interior, NonManifold
X_7 = UnitX(Factor="56000")
move_7 = Move(Geometry=edges_4.Naked, Motion=X_7)  # -> Geometry, Transform
join_4 = JoinCurves(Curves=move_7.Geometry, Preserve=False)

# ---- group: Shape grammar design (using SortalGI)
pt_8 = Point(<point referenced from the Rhino model>)
multiplication_4 = Multiplication(A="56000", B="6")
X_8 = UnitX(Factor=multiplication_4)
move_8 = Move(Geometry=pt_8, Motion=X_8)  # -> Geometry, Transform

# ---- group: Shape grammar design (using SortalGI) / Design option 1 building outline
boundary_5 = BoundarySurfaces(Edges=move_shape_5.G)
sunion_5 = SolidUnion(Breps=boundary_5)
edges_5 = BrepEdges(Brep=sunion_5)  # -> Naked, Interior, NonManifold
X_9 = UnitX(Factor="56000")
move_9 = Move(Geometry=edges_5.Naked, Motion=X_9)  # -> Geometry, Transform

# ---- group: Shape grammar design (using SortalGI)
pt_9 = Point(<point referenced from the Rhino model>)
multiplication_5 = Multiplication(A="56000", B="6")
X_10 = UnitX(Factor=multiplication_5)
move_10 = Move(Geometry=pt_9, Motion=X_10)  # -> Geometry, Transform

# ---- group: Shape grammar design (using SortalGI) / Building ref. pts. on site
pt_10 = Point([<point referenced from the Rhino model> x7])

# ---- group: Shape grammar design (using SortalGI)
rule_info = SGIRuleInfo(rule=[rule_2, rule])  # -> info, lhS, rhS, predicates, directives
# ---------- rule_info: Python ----------
#
# SortalGI: A Sortal/Shape Grammar Interpreter Plugin
# 
# Copyright (c) 2018-2019, Rudi Stouffs <stouffs@sortal.org> 
# 
# SortalGI is free software; you can redistribute it and/or modify 
# it under the terms of the GNU General Public License as published 
# by the Free Software Foundation; either version 3 of the License, 
# or (at your option) any later version.
# 
# SortalGI is distributed in the hope that it will be useful,
# but WITHOUT ANY WARRANTY; without even the implied warranty of 
# MERCHANTABILITY or FITNESS FOR A PARTICULAR PURPOSE. See the 
# GNU General Public License for more details, <http://www.gnu.org/licenses/>.
# 
# @license GPL-3.0+ <http://spdx.org/licenses/GPL-3.0+>


"""
Deconstruct an SGI Rule (or pRule) object into its left-hand-side and right-hand-side 
shape objects, a multi-line text consisting of rule name and rule description, and 
its predicates and directives, if any.
-
    Args:
        rule: Rule object
    Returns:
        info: Multi-line text consisting of rule name and rule description
        lhS: Left-hand-side shape object
        rhS: Right-hand-side shape object
        predicates: Predicates text
        directives: Directives text
"""

ghenv.Component.Name = 'SGI Rule Info'
ghenv.Component.NickName = 'Rule Info'
ghenv.Component.Message = 'VER 0.9.0\nDEC_15_2019'
ghenv.Component.Category = "SGI"
ghenv.Component.SubCategory = "2 | Rule"

ghenv.Component.Params.Input[0].Name = "rule"
ghenv.Component.Params.Input[0].NickName = "rule"
ghenv.Component.Params.Input[0].Description = 'Rule object'
ghenv.Component.Params.Output[0].Name = "info"
ghenv.Component.Params.Output[0].NickName = "info"
ghenv.Component.Params.Output[0].Description = 'Multi-line text consisting of rule name and rule description'
ghenv.Component.Params.Output[1].Name = "lhS"
ghenv.Component.Params.Output[1].NickName = "lhS"
ghenv.Component.Params.Output[1].Description = 'Left-hand-side shape object'
ghenv.Component.Params.Output[2].Name = "rhS"
ghenv.Component.Params.Output[2].NickName = "rhS"
ghenv.Component.Params.Output[2].Description = 'Right-hand-side shape object'
ghenv.Component.Params.Output[3].Name = "predicates"
ghenv.Component.Params.Output[3].NickName = "predicates"
ghenv.Component.Params.Output[3].Description = 'Predicates text'
ghenv.Component.Params.Output[4].Name = "directives"
ghenv.Component.Params.Output[4].NickName = "directives"
ghenv.Component.Params.Output[4].Description = 'Directives text'

try: ghenv.Component.AdditionalHelpFromDocStrings = "1"
except: pass

__author__ = "akidribm"

# Sortal imports
from sortal.io.rhinoGH import (RhinoShape, ConvertShape, DrawShape)
from sortal import rule as ruleInstance

# Rhinoceros/Grasshopper library imports
import System
import Rhino.Geometry as rg
import Rhino.DocObjects as rdo
import Rhino as r
import rhinoscriptsyntax as rs
import clr
import Grasshopper.Kernel as gh
import scriptcontext as sc

rhdoc = r.RhinoDoc.ActiveDoc

e = gh.GH_RuntimeMessageLevel.Error
w = gh.GH_RuntimeMessageLevel.Warning

sgiName = 'sgi_' + ghdoc.Name
if sgiName[-1] == '*':
    sgiName = sgiName[:-1]

if sgiName in sc.sticky:
    validInputs = True

    if rule is not None:
        if not isinstance(rule, ruleInstance):
            validInputs = False
            ghenv.Component.AddRuntimeMessage(e, "rule must be a rule object")

    if rule is not None and validInputs:
        print(rule.name)
        info = [rule.name, rule.description]

        # Generating rule sides' shape objects
        if ConvertShape.checkParametric(rule.lhs):
            lhshape, exclusion = ConvertShape(rule.lhs, [], sc.sticky[sgiName]).toConverseForm()
            rhshape, exclusion = ConvertShape(rule.rhs, [], sc.sticky[sgiName]).toConverseForm()
            predicates = rule.predicateString()[3:]
            directives = rule.directiveString()[3:]
        else:
            lhshape = rule.lhs
            rhshape = rule.rhs

        lhS = DrawShape(lhshape, sc.sticky[sgiName]).toRhinoShape()
        rhS = DrawShape(rhshape, sc.sticky[sgiName]).toRhinoShape()
           
else:
    ghenv.Component.AddRuntimeMessage(e, "Sortal library has not yet been set up. Please add the SGI Setup component.")
# ---------- end rule_info ----------
panel = Panel("56000")
panel_2 = Panel("40000")
panel_3 = Panel(rule_info.info)
update = SGIUpdate(updateThisFile=button)  # -> success; inputs updateThisFile: Boolean
# ---------- update: Python ----------
"""
The code in this component is adapted from the Ladybug Ladybug_Update Component by Mostapha Roudsari.
***************************************************************************************
*    Title: Ladybug Ladybug_Update Update Component 
*    Author: Mostapha Roudsari 
*    Date: Jul 28, 2017
*    Code version: Ladybug 0.0.65
*    Availability: http://www.food4rhino.com/app/ladybug-tools
***************************************************************************************
-
Updates the code inside components to match the latest version of the similarly-named component in the sourceDirectory or in the Grasshopper User Objects folder.
-
Args:
    sourceDirectory: Optional directory address of the location of new user objects. If no input is provided here, then SGI Update checks the first layer of the UserObjects folder
    updateThisFile: Input True to update the components in the current GH file; all other inputs will be treated as False
-        
Returns:
    success: True or Null indicating success of the update
"""

ghenv.Component.Name = "SGI Update"
ghenv.Component.NickName = 'Update'
ghenv.Component.Message = 'VER 0.8.2\nNOV_26_2019'
ghenv.Component.IconDisplayMode = ghenv.Component.IconDisplayMode.application
ghenv.Component.Category = "SGI"
ghenv.Component.SubCategory = "0 | Grammar"

ghenv.Component.Params.Input[0].Name = "sourceDirectory"
ghenv.Component.Params.Input[0].NickName = "sourceDirectory"
ghenv.Component.Params.Input[0].Description = 'Optional directory address of the location of new user objects. If no input is provided here, then SGI Update checks the first layer of the UserObjects folder'
ghenv.Component.Params.Input[1].Name = "updateThisFile"
ghenv.Component.Params.Input[1].NickName = "updateThisFile"
ghenv.Component.Params.Input[1].Description = 'Input True to update the components in the current GH file; all other inputs will be treated as False'
ghenv.Component.Params.Output[0].Name = "success"
ghenv.Component.Params.Output[0].NickName = "success"
ghenv.Component.Params.Output[0].Description = 'True or Null indicating success of the update'

try: ghenv.Component.AdditionalHelpFromDocStrings = "1"
except: pass

import scriptcontext as sc
import Grasshopper.Kernel as gh
import os
import shutil
import zipfile
import time
import urllib
import Grasshopper.Folders as folders
import System

def getAllTheComponents(onlyGHPython = True):
    
    components = []
    
    document = ghenv.Component.OnPingDocument()
    
    objects = list(document.Objects)
    
    # check if there is any cluster and collect the objects inside clusters
    for obj in objects:
        if type(obj) == gh.Special.GH_Cluster:
            clusterDoc = obj.Document("")
            if not clusterDoc:
                continue
            for clusterObj in  clusterDoc.Objects:
                objects.append(clusterObj)
    
    for component in objects:
        if onlyGHPython and type(component)!= type(ghenv.Component):
            pass
        else:
            components.append(component)
    
    return components

def updateTheComponent(component, newUOFolder, fixedData):

    def isNewerVersion(currentUO, component):
        # check if the component has a newer version than the current userObjects
        # get the code insider the userObject
        ghComponent = currentUO.InstantiateObject()

        # version of the connected component
        if component.Message == None:
            return True, ghComponent.Code
        if len(component.Message.split("\n"))<2:
            return True, ghComponent.Code
        
        ghVersion, ghDate = component.Message.split("\n")
        
        ghCompVersion = map(int, ghVersion.split("VER ")[1].split("."))
        
        month, day, ghYear  = ghDate.split("_")

        # print version, date
        month = fixedData.monthList.index(month.upper()) + 1
        ghCompDate = int(fixedData.getJD(month, day))
        
        # this is not the best way but works for now!
        # should be a better way to compute the component and get the message
        componentCode = ghComponent.Code.split("\n")
        UODate = ghCompDate - 1

        # version of the file
        for lineCount, line in enumerate(componentCode):
            if lineCount > 200: break

            if line.strip().startswith("ghenv.Component.Message"):
                #print line
                # print line.split("=")[1].strip().split("\n")
                version, date = line.split("=")[1].strip().split("\\n")
                
                # in case the file doesn't have an standard SGI message let it be updated
                try:
                    UOVersion = map(int, version.split("VER ")[1].split("."))
                except Exception, e:
                    return True, ghComponent.Code
                month, day, UOYear  = date.split("_")
                month = fixedData.monthList.index(month.upper()) + 1
                UODate = int(fixedData.getJD(month, day))
                break
                
        # check if the version of the code is newer
        if int(ghYear.strip()) < int(UOYear[:-1].strip()):
            return True, ghComponent.Code
        elif ghCompDate < UODate:
            return True, ghComponent.Code
        elif ghCompDate == UODate:
            for ghVer, UOVer in zip(UOVersion, UOVersion):
                if ghVer > UOVer: return False, " "
            return True, ghComponent.Code
        else:
            return False, " "
    
    # check if the userObject is already existing in the folder
    try:
        filePath = os.path.join(newUOFolder, component.Name + ".ghuser")
        newUO = gh.GH_UserObject(filePath)

    except:
        # there is no newer userobject with the same name so just return
        return
    
    # if is newer remove
    isNewer, newCode = isNewerVersion(newUO, component)

    # replace the code inside the component with userObject code
    if isNewer:
        if component.CodeInputParam == None:
            component.Code = newCode
            component.ExpireSolution(True)
        else:
            warning = "Failed to update %s. Remove code input from the component and try again!"%component.Name
            ghenv.Component.AddRuntimeMessage(gh.GH_RuntimeMessageLevel.Warning, warning)
    

def main(sourceDirectory, updateThisFile):
    sgiName = 'sgi_' + ghdoc.Name
    if sgiName[-1] == '*':
        sgiName = sgiName[:-1]

    #if sgiName not in sc.sticky:
    #    return "Sortal library has not yet been set up. Please add the SGI Setup component.", False

    fixedData = sc.sticky['sgi_fixed_data']()
    
    if sourceDirectory == None:
        userObjectsFolder = folders.ClusterFolders[0]
        
    else:
        userObjectsFolder = sourceDirectory

    destinationDirectory = folders.ClusterFolders[0]
    #print sourceDirectory, userObjectsFolder
    try:
        srcFiles = os.listdir(userObjectsFolder)
    except:
        warning = "The address you have inputted for sourceDirectory does not exist."
        ghenv.Component.AddRuntimeMessage(gh.GH_RuntimeMessageLevel.Error, warning)
    
    # copy files from source to destination
    if updateThisFile:

        if not userObjectsFolder  or not os.path.exists(userObjectsFolder):
            return "Source directory address is not a valid address.", False
            #w = gh.GH_RuntimeMessageLevel.Warning
            #ghenv.Component.AddRuntimeMessage(w, warning)
            #return warning, False

        srcFiles = os.listdir(userObjectsFolder)
        print 'Removing Old Version...'
        # remove userobjects that are currently removed
        fileNames = os.listdir(destinationDirectory)

        for fileName in fileNames:
            # check for SGI userObjects and delete the files if they are not
            # in source anymore
            if fileName.StartsWith('SGI'):
                continue            
            elif fileName.StartsWith('SGI') and fileName not in srcFiles:
                fullPath = os.path.join(destinationDirectory, fileName)
                os.remove(fullPath)                

    print 'Updating...'

    for srcFileName in srcFiles:
        # check for SGI userObjects
        if srcFileName.StartsWith('SGI') or srcFileName.StartsWith('Text Label'):
            srcFullPath = os.path.join(userObjectsFolder, srcFileName)
            dstFullPath = os.path.join(destinationDirectory, srcFileName) 

            # Checks if a new version already exists
            if not os.path.isfile(dstFullPath): shutil.copy2(srcFullPath, dstFullPath)
            # or is older than the new file
            elif os.stat(srcFullPath).st_mtime - os.stat(dstFullPath).st_mtime > 1: shutil.copy2(srcFullPath, dstFullPath)

    # To update code within components
    # Only works on components with the same inputs/outputs as their previous versions

    if updateThisFile:
        # find all the userObjects
        ghComps = getAllTheComponents()
        # for each of them check and see if there is a userObject with the same name is available
        for ghComp in ghComps:
            
            if ghComp.Name != 'SGI Update':
                updateTheComponent(ghComp, userObjectsFolder, fixedData)
                
        return 'Done!', True

if updateThisFile:
    msg, success = main(sourceDirectory, updateThisFile)
    
    if not success:
        ghenv.Component.AddRuntimeMessage(gh.GH_RuntimeMessageLevel.Warning, msg)
    else:
        print msg
else:
    print " "
# ---------- end update ----------
join_5 = JoinCurves(Curves=move_9.Geometry, Preserve=False)
item = ListItem(List=flatten(join_5), Index=0, Wrap=True)
flip = FlipCurve(Curve=join_2)  # -> Curve, Flag
flip_2 = FlipCurve(Curve=join_5, Guide=item)  # -> Curve, Flag
group = Group(Objects=flatten(flip_2.Curve))
group_2 = Group(Objects=flatten(join))
group_3 = Group(Objects=flatten(flip.Curve))
flip_3 = FlipCurve(Curve=join_4)  # -> Curve, Flag
flip_4 = FlipCurve(Curve=join_3)  # -> Curve, Flag
merge = Merge(
    Data1=flatten(flip_3.Curve),
    Data2=flatten(group),
    Data3=flatten(group_2),
    Data4=flatten(flip_4.Curve),
    Data5=flatten(group_3))
merge_2 = Merge(Data1=move_8.Geometry, Data2=move_10.Geometry, Data3=move_4.Geometry, Data4=move_5.Geometry, Data5=move_6.Geometry)
item_2 = ListItem(List=merge_2, Index=list, Wrap=True)
building_outline_options = ListItem(List=merge, Index=list, Wrap=True)
move2pt = MoveToPoint(Geometry=building_outline_options, PointA=item_2, PointB=pt_10)  # -> Moved, Vector, Transform

# ---- group: Shape grammar design (using SortalGI) / Sets up the Sortal Grammar Interpreter
sgi_setup = SGISetup(displacementX=panel, displacementY=panel_2)  # -> success; inputs descriptions: list
# ---------- sgi_setup: Python ----------
#
# SortalGI: A Sortal/Shape Grammar Interpreter Plugin
# 
# Copyright (c) 2018-2019, Rudi Stouffs <stouffs@sortal.org> 
# 
# SortalGI is free software; you can redistribute it and/or modify 
# it under the terms of the GNU General Public License as published 
# by the Free Software Foundation; either version 3 of the License, 
# or (at your option) any later version.
# 
# SortalGI is distributed in the hope that it will be useful,
# but WITHOUT ANY WARRANTY; without even the implied warranty of 
# MERCHANTABILITY or FITNESS FOR A PARTICULAR PURPOSE. See the 
# GNU General Public License for more details, <http://www.gnu.org/licenses/>.
# 
# @license GPL-3.0+ <http://spdx.org/licenses/GPL-3.0+>


"""
Initialize the SortalGI engine.
-
Place this component first before placing any other SGI components, otherwise, use CTRL+B to ensure the node will run first.
-
The displacementX and displacementY values specify the relevant spacing between shapes resulting from rule applications (expressed as translation vectors). If no values are specified, the spacing will be calculated based on the bounding box of the input shape of the rule application.
-
Shape descriptions may be considered as attributes to shape elements, or as separate shape entities. In case of the latter, shape descriptions must be typed and type names must be predefined.
-
    Args:
        displacementX: Optional displacement value along x-axis for translating shapes resulting from rule applications
        displacementY: Optional displacement value along y-axis for translating shapes resulting from rule applications
        textSize: Optional text size for any labels or shape description that are attributes to shape elements
        descriptions: Shape description type names. These must be predefined before specified in the creation of a shape
    Returns:
        check: True or False indicating success of the setup
"""

# RHINO SPECIFIC IMPORTS | FROM PYTHON 3.5 to 2.7
from __future__ import print_function
from __future__ import division
from __future__ import unicode_literals
from __future__ import absolute_import

ghenv.Component.Name = 'SGI Setup'
ghenv.Component.NickName = 'SGI Setup'
ghenv.Component.Message = 'VER 0.9.0\nDEC_15_2019'
ghenv.Component.Category = "SGI"
ghenv.Component.SubCategory = "0 | Grammar"

ghenv.Component.Params.Input[0].Name = "displacementX"
ghenv.Component.Params.Input[0].NickName = "displacementX"
ghenv.Component.Params.Input[0].Description = 'Optional displacement value along x-axis for translating shapes resulting from rule applications'
ghenv.Component.Params.Input[1].Name = "displacementY"
ghenv.Component.Params.Input[1].NickName = "displacementY"
ghenv.Component.Params.Input[1].Description = 'Optional displacement value along y-axis for translating shapes resulting from rule applications'
ghenv.Component.Params.Input[2].Name = "textSize"
ghenv.Component.Params.Input[2].NickName = "textSize"
ghenv.Component.Params.Input[2].Description = 'Optional text size for any labels or shape description that are attributes to shape elements'
ghenv.Component.Params.Input[3].Name = "descriptions"
ghenv.Component.Params.Input[3].NickName = "descriptions"
ghenv.Component.Params.Input[3].Description = 'Shape description type names; these must be predefined before specified in the creation of a shape'
ghenv.Component.Params.Input[4].Name = "reset"
ghenv.Component.Params.Input[4].NickName = "reset"
ghenv.Component.Params.Input[4].Description = 'Reset the SortalGI engine'
ghenv.Component.Params.Output[0].Name = "success"
ghenv.Component.Params.Output[0].NickName = "success"
ghenv.Component.Params.Output[0].Description = 'True or False indicating success of the setup'

# Grasshopper/Rhino Libraries
import Grasshopper.Kernel as gh
import System
import Rhino
import rhinoscriptsyntax as rs
import scriptcontext as sc

# Import for transformations
from mpmath import pi, sin, cos
from copy import deepcopy

# Python built-ins
from builtins import range

# Grasshopper component imports
from Grasshopper.Kernel.Special import GH_ValueList, GH_ValueListItem 

# Sortal Library Imports
from sortal import (transformSet, rule, primitiveSort, point3D, point2D, coordinate, lineSegment3D, planeSegment2D, 
                    lineSegment2D, line3D, label, rWeight, disjunctiveSort, attributeSort, affineTransform,  
                    vector3D, vector2D, planeSegment3D, enumerative, sort, description, plane3D, pointP3D, lineSegmentP3D, planeSegmentP3D,
                    circle3D, circleP3D, ellipse3D, ellipseP3D, circularArc3D, ellipticalArc3D, bezierCurve3D, bezierCurveP3D)

try: ghenv.Component.AdditionalHelpFromDocStrings = "1"
except: pass

w = gh.GH_RuntimeMessageLevel.Warning
e = gh.GH_RuntimeMessageLevel.Error
                                        
# FixedData class keeps track of version number      
class fixed_data(object):
    """ Set of functions to prepare the GH file for updating components according to version date"""
    def __init__(self):
        self.monthList = ['JAN', 'FEB', 'MAR', 'APR', 'MAY', 'JUN', 'JUL', 'AUG', 'SEP', 'OCT', 'NOV', 'DEC']
        self.numOfDays = [0, 31, 59, 90, 120, 151, 181, 212, 243, 273, 304, 334, 365]
        self.numOfDaysEachMonth = [31, 28, 31, 30, 31, 30, 31, 31, 30, 31, 30, 31]
        self.numOfHours = [24 * numOfDay for numOfDay in self.numOfDays]
        
    def getJD(self, month, day):
        numOfDays = [0, 31, 59, 90, 120, 151, 181, 212, 243, 273, 304, 334]
        return numOfDays[int(month)-1] + int(day)

sc.sticky['sgi_fixed_data'] = fixed_data
sc.sticky['sgi_fixed_factor'] = 2.0

base_sort_name = 'rhshapes'

try:
    setup_values
    rerun = True
except NameError:
    #this is the first time this component ran
    setup_values = {}
    setup_values['text_size'] = 3.5
    setup_values['displacementX'] = False
    setup_values['displacementY'] = False
    setup_values['sort_name'] = base_sort_name
    rerun = False

if type(textSize) == type(''):
    textSize = float(textSize)
if (type(textSize) == type(1.0) or type(textSize) == type(0)) and textSize> 0.0:
    setup_values['text_size'] = textSize

if type(displacementX) == type(''):
    displacementX = float(displacementX)
if type(displacementX) == type(1.0) or type(displacementX) == type(0):
    setup_values['displacementX'] = displacementX

if type(displacementY) == type(''):
    displacementY = float(displacementY)
if type(displacementY) == type(1.0) or type(displacementY) == type(0):
    setup_values['displacementY'] = displacementY

sgiName = 'sgi_' + ghdoc.Name
if sgiName[-1] == '*':
    sgiName = sgiName[:-1]

if sgiName not in sc.sticky:
    newFile = True
    newInput = False
    sc.sticky[sgiName] = setup_values.copy()
else:
    newFile = False
    newInput = reset
    if sc.sticky[sgiName]['text_size'] != setup_values['text_size']:
        newInput = True
        sc.sticky[sgiName]['text_size'] = setup_values['text_size']
    if sc.sticky[sgiName]['displacementX'] != setup_values['displacementX']:
        newInput = True
        sc.sticky[sgiName]['displacementX'] = setup_values['displacementX']
    if sc.sticky[sgiName]['displacementY'] != setup_values['displacementY']:
        newInput = True
        sc.sticky[sgiName]['displacementY'] = setup_values['displacementY']

sort.register.clear()
rule.register.clear()

geomTypes = ['point', 'lineSeg', 'planeSeg', 'circle', 'ellipse', 'arc', 'bezier']

try:
    # Parametric geometric sorts
    pointSortP3D = primitiveSort('pointP3D', pointP3D)
    lineSegSortP3D = primitiveSort('lineSegP3D', lineSegmentP3D)
    planeSegSortP3D = primitiveSort('planeSegP3D', planeSegmentP3D) 
    circleSortP3D = primitiveSort('circleP3D', circleP3D) 
    ellipseSortP3D = primitiveSort('ellipseP3D', ellipseP3D) 
    bezSortP3D = primitiveSort('bezierP3D', bezierCurveP3D)
    
    # Non-parametric geometric sorts
    pointSort3D = primitiveSort('point3D', point3D)
    lineSegSort3D = primitiveSort('lineSeg3D', lineSegment3D)
    planeSegSort3D = primitiveSort('planeSeg3D', planeSegment3D) 
    #plSort = primitiveSort('plane', plane3D)
    circleSort3D = primitiveSort('circle3D', circle3D) 
    ellipseSort3D = primitiveSort('ellipse3D', ellipse3D) 
    arcSort3D = primitiveSort('arc3D', circularArc3D)  
    bezSort3D = primitiveSort('bezier3D', bezierCurve3D)
    
    # Initializes primitive attribute sorts in sortal library
    labelDescSort = primitiveSort('labelD', description)
    pointDescSort = primitiveSort('pLabelD', description)
    lineDescSort = primitiveSort('lLabelD', description)
    planeDescSort = primitiveSort('plLabelD', description)
    circleDescSort = primitiveSort('cLabelD', description)
    ellipseDescSort = primitiveSort('eLabelD', description)
    arcDescSort = primitiveSort('aLabelD', description)
    bezDescSort = primitiveSort('bLabelD', description)
    
    # For specific use with class partse_disjunctive_sort
    sortTypes = {'point3D': pointSort3D, 'lineSeg3D': lineSegSort3D, 'planeSeg3D': planeSegSort3D, 'circle3D': circleSort3D, 'ellipse3D': ellipseSort3D, 'arc3D': arcSort3D, 'bezier3D': bezSort3D, \
                 'pointP3D': pointSortP3D, 'lineSegP3D': lineSegSortP3D, 'planeSegP3D': planeSegSortP3D, 'circleP3D': circleSortP3D, 'ellipseP3D': ellipseSortP3D, 'bezierP3D': bezSortP3D, \
                 'pLabelD': pointDescSort, 'lLabelD': lineDescSort, 'plLabelD': planeDescSort, 'cLabelD': circleDescSort, 'eLabelD': ellipseDescSort, 'aLabelD': arcDescSort, 'bLabelD': bezDescSort, 'labelD': labelDescSort}

    sc.sticky['sgi_geo_names'] = ['point3D', 'lineSeg3D', 'planeSeg3D', 'circle3D', 'ellipse3D', 'arc3D', 'bezier3D']
    sc.sticky['sgi_pgeo_names'] = ['pointP3D', 'lineSegP3D', 'planeSegP3D', 'circleP3D', 'ellipseP3D', '', 'bezierP3D']
    sc.sticky['sgi_attr_names'] = ['pLabelD', 'lLabelD', 'plLabelD', 'cLabelD', 'eLabelD', 'aLabelD', 'bLabelD']
except:
    pass
        
# Class definiton for disjunctive sort setup 
class parse_disjunctive_sort:
                            
    def parseDisjSort(self, descs = None):
                    
        mainSorts = []   # Completed non-parametric sorts
        mainPSorts = []  # Completed parametric sorts
        descSorts = []

        if descs == None:
            descs = []
        elif type(descs) != type([]):
            descs = descs.split('\r\n')
        elif len(descs) == 1 and '\r\n' in descs[0]:
            descs = descs[0].split('\r\n')   
        
        if type(descs) == type([]) and len(descs) > 0:
            descs = sorted(descs)
            descSorts = self.makeDescription(descs)
            
        for ind in range(len(geomTypes)):
            baseSort = sortTypes[sc.sticky['sgi_geo_names'][ind]]
            attribSort = sortTypes[sc.sticky['sgi_attr_names'][ind]]
            fullSortName = baseSort.name + '_' + attribSort.name
            fullSort = attributeSort(fullSortName, baseSort, attribSort)
            mainSorts.append(fullSort)
            
            baseSort = sc.sticky['sgi_pgeo_names'][ind]
            if baseSort != '':
                baseSort = sortTypes[baseSort]
                fullSortName = baseSort.name + '_' + attribSort.name
                fullSort = attributeSort(fullSortName, baseSort, attribSort)
                mainPSorts.append(fullSort)
        
        for descSort in descSorts:
            mainSorts.append(descSort)
            mainPSorts.append(descSort)
            
        disjSortName = base_sort_name
        for desc in descs:
            disjSortName += '_' + desc
        fullDisjSort = disjunctiveSort(disjSortName, mainSorts)
        DisjSortP = disjunctiveSort(disjSortName + 'P', mainPSorts)
        return fullDisjSort   
    
    # Initializes description types based on input to 'descriptions'
    def makeDescription(self, descs):
        descSorts = []

        # Checks if description sort type already exists
        # If description sort already present, ignored
        # If not present, new description primitive sort created
        for desc in descs:
            if desc not in sort.register:
                descSorts.append(primitiveSort(desc, description))
    
        return descSorts

pds = parse_disjunctive_sort()
fullDisjSort = pds.parseDisjSort(descriptions)
setup_values['sort_name'] = fullDisjSort.name
if sc.sticky[sgiName]['sort_name'] != setup_values['sort_name']:
    if newFile == False:
        newInput = True
    sc.sticky[sgiName]['sort_name'] = setup_values['sort_name']

for x in fullDisjSort.component:
    print (x.name + ' : ' + x.description)
print(fullDisjSort.name + ' : ' + fullDisjSort.description)
fullDisjSort = sort.register[fullDisjSort.name + 'P']
for x in fullDisjSort.component:
    print (x.name + ' : ' + x.description)
print(fullDisjSort.name + ' : ' + fullDisjSort.description)

if rerun and (newInput or newFile):
    for scriptObj in ghenv.Component.OnPingDocument().Objects:
        if 'SGI' in scriptObj.Name and ('Shape' in scriptObj.Name or 'Import' in scriptObj.Name):
            scriptObj.ExpireSolution(True)

success = True
# ---------- end sgi_setup ----------

# ----
ungroup = Ungroup(Group=move2pt.Moved)
crv_15 = Curve(ungroup)

# ---- group: Building model according to existing building heights and density on site
Z = UnitZ(Factor="3000")
arrlinear = LinearArray(Geometry=move2pt.Moved, Direction=Z, Count="32")  # -> Geometry, Transform
boundary_6 = BoundarySurfaces(Edges=crv_15)
multiplication_6 = Multiplication(A="3000", B="32")
swatch = ColourSwatch(SwatchColor=RGB(0, 0, 0))
division = Division(A=multiplication_6, B="1000")
Z_2 = UnitZ(Factor=multiplication_6)
extr = Extrude(Base=boundary_6, Direction=Z_2)
debrep = DeconstructBrep(Brep=extr)  # -> Faces, Edges, Vertices
panel_4 = Panel("""0
-1""")
cull_i = CullIndex(List=debrep.Faces, Indices=panel_4, Wrap=True)
srf = Surface(debrep.Faces)
swatch_2 = ColourSwatch(SwatchColor=RGB(255, 255, 255))
mesh_uv = MeshSurface(Surface=cull_i, UCount="32", VCount="16", Overhang=True, Equalize=False)  # -> flatten(Mesh)
item_3 = ListItem(List=srf, Index=panel_4, Wrap=True)
mesh = Mesh(mesh_uv)
demesh = DeconstructMesh(Mesh=mesh)  # -> flatten(Vertices), Faces, Colours, Normals
lng = ListLength(List=demesh.Vertices)
panel_5 = Panel(lng)

# ---- group: Daylight analysis (using Sunflower Pro) / Analysis date and time (according to regulations)
D = DateTime(Year="2001", Month="1", Day="20", Hour="8", Minute=0, Second=0)
D_2 = DateTime(Year="2001", Month="1", Day="20", Hour="16", Minute=0, Second=0)
times = DateTimes(DateTimeStart=D, DateTimeEnd=D_2, MinuteInterval=10)

# ---- group: Daylight analysis (using Sunflower Pro) / Analysis coordinate (according to regulations)
L = Location_Coordinate(Degree="120", Minute="37", Second=0)
L_2 = Location_Coordinate(Degree="31", Minute="19", Second=0)
L_3 = Location(Latitude=L_2, Longitude=L)

# ---- group: Building Selector
number_slider = Slider(1, range=0..1)

# ---- group: Daylight analysis (using Sunflower Pro) / Daylight analysis
S = SolarAnalysisMeshFace(DateTime=times, Location=L_3, Mesh=mesh, ONOFF=run)  # -> Mesh, Point, Hour, Minutes
lng_2 = ListLength(List=pt_10)
allocb = DataAllocationB(Data=S.Mesh, NumberOfBranches=lng_2)  # -> simplify(Data)
subtraction = Subtraction(A=lng_2, B="1")
dom = ConstructDomain(DomainStart=0, DomainEnd=subtraction)
dom_2 = ConstructDomain(DomainStart=0, DomainEnd=1)
remap = RemapNumbers(Value=number_slider, Source=dom_2, Target=dom)  # -> Mapped, Clipped
int = Integer(remap.Mapped)
branch = TreeBranch(Tree=allocb, Path=int, MaintainPaths=True)

# ---- group: Building Selector (continued)
panel_6 = Panel(int)

# ---- group: Preview to show masterplan
preview = CustomPreview(Geometry=arrlinear.Geometry, Material=swatch)
mesh_2 = Mesh(allocb)
wires = BrepWireframe(Brep=item_3, Density=-1)
preview_2 = CustomPreview(Geometry=item_3, Material=swatch_2)

# ----
graft = GraftTree(Tree=branch, IncludeEmptyLists=True, IncludeNullItems=True)

# ---- group: Display and checking results of the main facade
item_4 = ListItem(List=move2pt.Moved, Index=0, Wrap=True)

# ----
ungroup_2 = Ungroup(Group=item_4)

# ---- group: Display and checking results of the main facade / Extract main facade models to be tested
facen = FaceNormals(Mesh=branch)  # -> Centers, Normals
pdecon = Deconstruct(Point=facen.Normals)  # -> XComponent, YComponent, ZComponent
addition = Addition(A=pdecon.XComponent, B=pdecon.YComponent)
smaller = SmallerThan(FirstNumber=addition, SecondNumber="0")  # -> SmallerThan, OrEqualTo

# ----
amp = Amplitude(Vector=facen.Normals, Amplitude="4000")
vdis = VectorDisplay(Anchor=facen.Centers, Vector=amp)

item_5 = ListItem(List=smaller.SmallerThan, Index="0", Wrap=True)

# ---- group: Display and checking results of the main facade / Extract main facade models to be tested (continued)
cull = CullPattern(List=graft, CullPattern=item_5)
null = NullItem(Item=cull)  # -> NullFlags, InvalidFlags, Description
cull_2 = CullPattern(List=graft, CullPattern=invert(null.NullFlags))

# ---- group: Display and checking results of the main facade (continued)
explode = Explode(Curve=ungroup_2, Recursive=True)  # -> graft(Segments), Vertices

# ----
flatten = FlattenTree(Tree=explode.Segments, Path="{0}")

# ---- group: Display and checking results of the main facade (continued)
lng_3 = ListLength(List=flatten)

# ---- group: Display and checking results of the main facade / Extract daylight hour data from main facades
pt_11 = Point(flatten(S.Point))
txt = Text(flatten(S.Hour))
allocb_2 = DataAllocationB(Data=pt_11, NumberOfBranches=lng_2)
allocb_3 = DataAllocationB(Data=txt, NumberOfBranches=lng_2)

# ----
simplify = SimplifyTree(Tree=allocb_2, Front=False)
simplify_2 = SimplifyTree(Tree=allocb_3, Front=False)
branch_2 = TreeBranch(Tree=simplify, Path=int, MaintainPaths=True)
branch_3 = TreeBranch(Tree=simplify_2, Path=int, MaintainPaths=True)
allocb_4 = DataAllocationB(Data=branch_2, NumberOfBranches=lng_3)

# ---- group: Display and checking results of the main facade / Extract daylight hour data from main facades (continued)
allocb_5 = DataAllocationB(Data=branch_3, NumberOfBranches=lng_3)
cull_3 = CullPattern(List=allocb_4, CullPattern=item_5)
cull_4 = CullPattern(List=allocb_5, CullPattern=item_5)

# ---- group: Display and checking results of the main facade / Daylight hour tags display on model
tag = TextTag(Location=cull_3, Text=cull_4, Colour=ColourSwatch(SwatchColor=RGB(0, 0, 0)))

# ---- group: Display and checking results of the main facade / Check whether main facade compiles with daylight regulation (min. 2-hour daylight hour)
ddate = DeconstructDate(Date=cull_4)  # -> Year, Month, Day, Hour, Minute, Second
multiplication_7 = Multiplication(A=ddate.Hour, B="60")
addition_2 = Addition(A=multiplication_7, B=ddate.Minute)  # -> flatten(Result)
larger = LargerThan(FirstNumber=addition_2, SecondNumber="120")  # -> LargerThan, OrEqualTo
panel_7 = Panel(larger.OrEqualTo)

# ----
lng_4 = ListLength(List=addition_2)
ma = MassAddition(Input=addition_2)  # -> Result, PartialResults
division_2 = Division(A=ma.Result, B=lng_4)
panel_8 = Panel(ma.Result)
panel_9 = Panel(lng_4)
panel_10 = Panel(division_2)
cull_5 = CullPattern(List=addition_2, CullPattern=invert(larger.OrEqualTo))
cull_6 = CullPattern(List=addition_2, CullPattern=larger.OrEqualTo)
lng_5 = ListLength(List=cull_6)
panel_11 = Panel(lng_5)
lng_6 = ListLength(List=cull_5)
panel_12 = Panel(lng_6)
